# Grasshopper definition 1 Reading FIles.gh (Grasshopper 1.0.8)

# ----
# Reading textfiles (with Grasshopper)
path = FilePath("C:\Users\VincentNowak\Dropbox\UCL RC15 Skills 2025\PervasiveUrbanism_25-26\Skills Module 1 Cartographies of Affect\Skills 1 - Day 3 Geodata in Grasshopper\3. Importing Text Files\004RC16S.CSV")
file = ReadFile(File=path, PerLineParse=True)
panel = Panel(file)
cull_i = CullIndex(List=file, Indices="0", Wrap=True)
tab = Panel("\t")
split = TextSplit(Text=cull_i, Separators=tab)
panel_2 = Panel(split)
item = ListItem(List=split, Index="3", Wrap=True)  # -> Item, Item1
pt = ConstructPoint(XCoordinate=item.Item1, YCoordinate=item.Item, ZCoordinate=0)

# ----
# Reading textfiles (with Python)
path_2 = FilePath("C:\Users\VincentNowak\Dropbox\UCL RC15 Skills 2025\PervasiveUrbanism_25-26\Skills Module 1 Cartographies of Affect\Skills 1 - Day 3 Geodata in Grasshopper\3. Importing Text Files\004RC16S.CSV")
py3 = Python3Script(filepath=path_2)  # -> out, flatten(latitude), flatten(longitude); inputs filepath: String
# ---------- py3: Python ----------
# import the csv module. no installation required, it is a standard module
import csv

# create two empty lists. they will be filled with values in the next step
latitude = []
longitude = [] 

# read the csv file with the syntax below. note that the delimeter is a tab (\t) in this case
# read the textfile line-by-line, extract the value and append it to the list. 
with open(filepath, newline='', encoding='utf-8') as csvfile:
    reader = csv.reader(csvfile, delimiter='\t')
    for row in reader:
        latitude.append(row[3])
        longitude.append(row[4])
        #print(row)

# the first value is a string. and that has to be removed... 
del latitude[0]
del longitude[0]

print(latitude)
# ---------- end py3 ----------
pt_2 = ConstructPoint(XCoordinate=py3.longitude, YCoordinate=py3.latitude, ZCoordinate=0)

flatten = FlattenTree(Tree=pt, Path="{0}")
item_2 = ListItem(List=flatten, Index=0, Wrap=True)
rev = Reverse(Vector=item_2)
move = Move(Geometry=flatten, Motion=rev)  # -> Geometry, Transform
scale = Scale(Geometry=move.Geometry, Center=Point(0, 0, 0), Factor=Slider(10, range=0..10))  # -> Geometry, Transform
