# Grasshopper definition Full Example.gh (Grasshopper 1.0.7)
# plug-ins: Human, MeshEdit Components, EleFront

geo = Geometry(<point referenced from the Rhino model>)

# ---- group: Input
geo_2 = Geometry([<point referenced from the Rhino model> x75])
x = Panel("12")
y = Panel("10")

# ---- group: Inclusion
sqgrid = Square(Plane=geo, Size="90", ExtentX=x, ExtentY=y)  # -> flatten(Cells), Points
area = Area(Geometry=sqgrid.Cells)  # -> Area, Centroid
merge = Merge(Data1=geo_2, Data2=area.Centroid)
pt = Point(merge)
incurves = PointInCurves(Point=pt, Curves=sqgrid.Cells)  # -> Relationship, Index, Point
python = GhPythonScript(numbers=incurves.Index)  # -> out, simplify(a); inputs numbers: list of Int32
# ---------- python: Python ----------
import ghpythonlib.treehelpers as th

index_dict = {}
for index, number in enumerate(numbers):
    if number not in index_dict:
        index_dict[number] = []
    index_dict[number].append(index)

# Ensure all numbers from 0 to max(numbers) are included
max_number = max(numbers)
sorted_index_lists = [index_dict.get(i, []) for i in range(max_number + 1)]

from pprint import pprint
pprint(sorted_index_lists)
pprint(index_dict)





a = th.list_to_tree(sorted_index_lists)
# ---------- end python ----------
tstat = TreeStatistics(Tree=python.a)  # -> Paths, Length, Count

# ---- group: Decoration
geo_3 = Geometry([<curve referenced from the Rhino model> x2])
move = Move(Geometry=geo_3, Motion=graft(area.Centroid))  # -> Geometry, Transform
swatch = ColourSwatch(SwatchColor=RGB(115, 115, 115))
preview = CustomPreview(Geometry=move.Geometry, Material=swatch)
createatts = CreateAttributes(LayerName="Cross", Color=swatch, enableFullPath=False)
bake = BakeGeometry(Bake=Button(), Geometry=flatten(move.Geometry), Attributes=createatts, DeleteOldBakes=False, PreserveTrees=False)
createatts_2 = CreateAttributes(LayerName="Grid", Color=swatch, enableFullPath=False)
bake_2 = BakeGeometry(Bake=Button(), Geometry=flatten(sqgrid.Cells), Attributes=createatts_2, DeleteOldBakes=False, PreserveTrees=False)

# ---- group: Surface Grid
# Add contrast by "streching" the numbers
bnd = Bounds(Numbers=tstat.Length)
dom = ConstructDomain(DomainStart="30", DomainEnd="130")
remap = RemapNumbers(Value=tstat.Length, Source=bnd, Target=dom)  # -> Mapped, Clipped
Z = UnitZ(Factor=remap.Mapped)
move_2 = Move(Geometry=area.Centroid, Motion=Z)  # -> Geometry, Transform
srfgrid = SurfaceFromPoints(Points=move_2.Geometry, UCount=x, Interpolate=Toggle(True))

# ---- group: Alternative
frompoints = MeshFromPoints(Points=move_2.Geometry, UDirection=x, VDirection=y)
subdmesh = SubDFromMesh(Mesh=frompoints, Creases=2, Corners=2, Interpolate=Toggle(True))

# ---- group: Graphics & Baking
contour = Contour(Shape=subdmesh, Point=Point(0, 0, 0), Direction=Vector(0, 0, 1), Distance=Slider(1, range=0..1))
eval = EvaluateCurve(Curve=reparameterize(contour), Parameter=0)  # -> Point, Tangent, Angle
pdecon = Deconstruct(Point=eval.Point)  # -> XComponent, YComponent, ZComponent
bnd_2 = Bounds(Numbers=flatten(pdecon.ZComponent))
dedomain = DeconstructDomain(Domain=bnd_2)  # -> Start, End
gradient = Gradient(
    LowerLimit=dedomain.Start,
    UpperLimit=dedomain.End,
    Parameter=flatten(pdecon.ZComponent),
    stops=[0: RGB(234, 38, 0), 0.25: RGB(234, 126, 0), 0.5: RGB(254, 244, 84), 0.75: RGB(173, 203, 249), 1: RGB(75, 107, 169)])
preview_2 = CustomPreview(Geometry=flatten(contour), Material=gradient)
createatts_3 = CreateAttributes(LayerName="Contours", Color=gradient, enableFullPath=False)
bake_3 = BakeGeometry(Bake=Button(), Geometry=flatten(contour), Attributes=createatts_3, DeleteOldBakes=False, PreserveTrees=False)

# ---- group: How to get attributes and how to do Wurman Dots
item = ListItem(List=pt, Index=python.a, Wrap=True)
getuv = GetUserValue(Geometry=item, Key="Value")
nullrep = ReplaceNulls(Items=getuv, Replacements="0")  # -> Items, Count
dom_2 = ConstructDomain(DomainStart="2", DomainEnd="40")
xy = XYPlane(Origin=area.Centroid)  # -> graft(Plane)

# ----
num = Number(nullrep.Items)
avr = Average(Input=num)

# ---- group: How to get attributes and how to do Wurman Dots (continued)
bnd_3 = Bounds(Numbers=flatten(avr))
remap_2 = RemapNumbers(Value=avr, Source=bnd_3, Target=dom_2)  # -> Mapped, Clipped
cir = Circle(Plane=xy, Radius=remap_2.Mapped)

# ----
panel = Panel(avr)
