# Grasshopper definition 2 Display Coordinates.gh (Grasshopper 1.0.8)
# plug-ins: Heron, eleFront

path = FilePath("C:\Users\VincentNowak\Dropbox\UCL RC15 Skills 2025\PervasiveUrbanism_25-26\Skills Module 1 Cartographies of Affect\Skills 1 - Day 3 Geodata in Grasshopper\3. Importing Text Files\004RC16S.CSV")
file = ReadFile(File=path, PerLineParse=True)
panel = Panel(file)
cull_i = CullIndex(List=file, Indices="0", Wrap=True)
tab = Panel("\t")
split = TextSplit(Text=cull_i, Separators=tab)
panel_2 = Panel(split)
item = ListItem(List=split, Index="3", Wrap=True)  # -> Item, Item1

# ----
# SET ANCHOR POINT
# The earth anchor point has to be set in any case.
# The 0,0,0 point of Rhino has to be set to a real world coordinate.
# You can get the point by searching for it. Or you simply look up a place in google maps, copy/paste the cooridantes and plug them into the "SetEAP" component.
panel_3 = Panel("Victoria Park, London")
restgeocode = ESRIRESTServiceGeocode(Addresses=panel_3)  # -> Candidates, Latitude, Longitude
lat = Panel("51.6051967")
long = Panel("-0.1839994")
panel_4 = Panel(restgeocode.Candidates)
branch = TreeBranch(Tree=restgeocode.Candidates, Path="0;0", MaintainPaths=True)
branch_2 = TreeBranch(Tree=restgeocode.Latitude, Path="0;0", MaintainPaths=True)
branch_3 = TreeBranch(Tree=restgeocode.Longitude, Path="0;0", MaintainPaths=True)
panel_5 = Panel(branch)
seteap = SetEarthAnchorPoint(SetEAP=Toggle(True), Latitude=branch_2, Longitude=branch_3)

# ----
# CONVERT COORDINATES TO XY VALUES
flatten = FlattenTree(Tree=item.Item, Path="{0}")
flatten_2 = FlattenTree(Tree=item.Item1, Path="{0}")
ddtoxy = DecimalDegreesToXY(Latitude=flatten, Longitude=flatten_2)  # -> XyPoint, Transform
geo = Geometry(ddtoxy.XyPoint)
panel_6 = Panel(ddtoxy.XyPoint)

# ----
# Bake with attributes (optional)
item_2 = ListItem(List=split, Index="7", Wrap=True)
tstat = TreeStatistics(Tree=item_2)  # -> Paths, Length, Count
dup = DuplicateData(Data="GSR", Number=tstat.Length, Order=True)  # -> simplify(Data)
ef_att = EleFrontAttributes(Keys=dup, Values=item_2, Layer="Points")  # -> flatten(Attributes), Keys, Values, Name, Layer, ColourSource, DisplayColour, MaterialSource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
bake = BakeObjects(Geometry=geo, Attributes=ef_att.Attributes, Bake=False, createGroups=False)  # -> Message, Ghosts
