# Grasshopper definition Import Background Image.gh (Grasshopper 1.0.8)
# plug-ins: Heron

# ---- group: Catalog of ESRI ArcGIS REST Basemaps
esri_arcgis_base_maps = ValueList({"World Imagery": "http://server.arcgisonline.com/ArcGIS/rest/services/World_Imagery/MapServer/export?", "World Topographic": "http://server.arcgisonline.com/ArcGIS/rest/services/World_Topo_Map/MapServer/export?", "World Physical Map": "http://server.arcgisonline.com/ArcGIS/rest/services/World_Physical_Map/MapServer/export?", "World Street Map": "http://server.arcgisonline.com/ArcGIS/rest/services/World_Street_Map/MapServer/export?", "World DeLorme Street Map": "http://server.arcgisonline.com/ArcGIS/rest/services/Specialty/DeLorme_World_Base_Map/MapServer/export?", "World Shaded Relief": "http://server.arcgisonline.com/ArcGIS/rest/services/World_Shaded_Relief/MapServer/export?", "World Terrain Base": "http://server.arcgisonline.com/ArcGIS/rest/services/World_Terrain_Base/MapServer/export?", "World Boundaries and Places": "http://server.arcgisonline.com/ArcGIS/rest/services/Reference/World_Boundaries_and_Places/MapServer/export?", "World Boundaries and Places Alt": "http://server.arcgisonline.com/ArcGIS/rest/services/Reference/World_Boundaries_and_Places_Alternate/MapServer/export?", "World Reference Overlay": "http://server.arcgisonline.com/ArcGIS/rest/services/Reference/World_Reference_Overlay/MapServer/export?", "World Transportation": "http://server.arcgisonline.com/ArcGIS/rest/services/Reference/World_Transportation/MapServer/export?", "World Light Gray Base": "http://server.arcgisonline.com/ArcGIS/rest/services/Canvas/World_Light_Gray_Base/MapServer/export?", "World Light Gray Reference": "http://server.arcgisonline.com/ArcGIS/rest/services/Canvas/World_Light_Gray_Reference/MapServer/export?", "National Geographic World": "http://services.arcgisonline.com/ArcGIS/rest/services/NatGeo_World_Map/MapServer/export?", "USA Topo Maps": "http://server.arcgisonline.com/ArcGIS/rest/services/USA_Topo_Maps/MapServer/export?"}, selected="World Imagery")

# ---- group: Not all imagery available at each resolution
resolution = ValueList({"None": , "Low": 256, "Med": 512, "High": 1024, "Max": 2048}, selected="Max")

# ---- group: USGS Raster Maps
usgs = ValueList({"Ortho 1 Foot Imagery": "http://raster.nationalmap.gov/arcgis/rest/services/Orthoimagery/USGS_EROS_Ortho_1Foot/ImageServer/exportImage?", "Ortho Imagery": "http://raster.nationalmap.gov/arcgis/rest/services/Orthoimagery/USGS_EROS_Ortho/ImageServer/exportImage?", "NAIP Imagery": "http://raster.nationalmap.gov/arcgis/rest/services/Orthoimagery/USGS_EROS_Ortho_NAIP/ImageServer/exportImage?", "Land Cover": "http://raster.nationalmap.gov/arcgis/rest/services/LandCover/USGS_EROS_LandCover_NLCD/MapServer/export?", "Land Cover - Conus 01": "http://raster.nationalmap.gov/arcgis/rest/services/LandCover/conus_01/MapServer/export?", "Land Cover - Conus 06": "http://raster.nationalmap.gov/arcgis/rest/services/LandCover/conus_06/MapServer/export?", "Land Cover - Development": "http://raster.nationalmap.gov/arcgis/rest/services/LandCover/Development_0106/MapServer/export?", "Land Cover - Wetland": "http://raster.nationalmap.gov/arcgis/rest/services/LandCover/Wetland_0106/MapServer/export?", "Topo - Scanned Maps": "http://raster.nationalmap.gov/arcgis/rest/services/Scanned_Maps/USGS_EROS_DRG_SCALE/ImageServer/exportImage?"}, selected="Ortho 1 Foot Imagery")

# ----
# READ FILE
path = FilePath("C:\Users\VincentNowak\Dropbox\UCL RC15 Skills 2025\PervasiveUrbanism_25-26\Skills Module 1 Cartographies of Affect\Skills 1 - Day 3 Geodata in Grasshopper\1. Importing Text Files\004RC16S.CSV")
file = ReadFile(File=path, PerLineParse=True)
panel = Panel(file)
cull_i = CullIndex(List=file, Indices="0", Wrap=True)
tab = Panel("\t")
split = TextSplit(Text=cull_i, Separators=tab)
panel_2 = Panel(split)
item = ListItem(List=split, Index="3", Wrap=True)  # -> Item, Item1

flatten = FlattenTree(Tree=item.Item, Path="{0}")
flatten_2 = FlattenTree(Tree=item.Item1, Path="{0}")
ddtoxy = DecimalDegreesToXY(Latitude=flatten, Longitude=flatten_2)  # -> XyPoint, Transform
panel_3 = Panel(ddtoxy.XyPoint)
panel_4 = Panel("""1551
2191""")
cull_i_2 = CullIndex(List=ddtoxy.XyPoint, Indices=panel_4, Wrap=True)
points = PointList(Points=cull_i_2, Size="1")

lat = Panel("51.547143413134414")
# CONVERT COORDINATES
long = Panel("-0.02326455792985868")
# SET ANCHOR POINT
toggle = BooleanToggle(True)
seteap = SetEarthAnchorPoint(SetEAP=toggle, Latitude=lat, Longitude=long)

# ---- group: Boundary Curve
# DO BACKGROUND IMAGE
geo = Geometry(<curve referenced from the Rhino model>)

# ----
folder_location_for_images = Panel("C:\Users\VincentNowak\Dropbox\UCL RC15 Skills 2025\PervasiveUrbanism_25-26\Skills Module 1 Cartographies of Affect\Skills 1 - Day 3 Geodata in Grasshopper\3. Raster Images\temp")
image_prefix = Panel("aerial")
restraster = GetRESTRaster(
    Boundary=geo,
    Resolution=resolution,
    TargetFolder=folder_location_for_images,
    Prefix=image_prefix,
    RESTURL=esri_arcgis_base_maps,
    ImageType="jpg",
    Run=Button())  # -> Image, ImageFrame, RESTQuery
panel_5 = Panel(esri_arcgis_base_maps)

panel_6 = Panel(restraster.Image)
