# Grasshopper definition Full Example2.gh (Grasshopper 1.0.8)
# plug-ins: Human, eleFront

# ---- group: Input
geo = Geometry([<point referenced from the Rhino model> x75])
x = Panel("12")
y = Panel("10")

# ----
geo_2 = Geometry(<point referenced from the Rhino model>)

# ---- group: Inclusion
sqgrid = Square(Plane=geo_2, Size="90", ExtentX=x, ExtentY=y)  # -> flatten(Cells), Points
area = Area(Geometry=sqgrid.Cells)  # -> Area, Centroid
merge = Merge(Data1=geo, Data2=area.Centroid)
pt = Point(merge)
incurves = PointInCurves(Point=pt, Curves=sqgrid.Cells)  # -> Relationship, Index, Point
multiplication = Multiplication(A=x, B=y)
series = Series(Start=0, Step=1, Count=multiplication)  # -> simplify(graft(Series))
equals = Equality(FirstNumber=incurves.Index, SecondNumber=series)  # -> Equality, Inequality
cull = CullPattern(List=pt, CullPattern=equals.Equality)

# ----
geo_3 = Geometry(cull)
getuv = GetUserValue(Geometry=geo_3, Key="Value")
shiftm = ShiftMatch(GuideTree=geo_3, SecondaryData1=getuv, shiftFromStart=False)  # -> GuideTree, SecondaryData1
nullrep = ReplaceNulls(Items=shiftm.SecondaryData1, Replacements="0")  # -> Items, Count
num = Number(nullrep.Items)
avr = Average(Input=num)
panel = Panel(avr)
pt_2 = Point(simplify(graft(area.Centroid)))
multiplication_2 = Multiplication(A=avr, B=Slider(9, range=0..10))
Z = UnitZ(Factor=multiplication_2)
move = Move(Geometry=pt_2, Motion=Z)  # -> Geometry, Transform
srfgrid = SurfaceFromPoints(Points=flatten(move.Geometry), UCount=x, Interpolate=Toggle(True))

# ---- group: Graphics & Baking
contour = Contour(Shape=srfgrid, Point=Point(0, 0, 0), Direction=Vector(0, 0, 1), Distance=Slider(1, range=0..1))
eval = EvaluateCurve(Curve=reparameterize(contour), Parameter=0)  # -> Point, Tangent, Angle
pdecon = Deconstruct(Point=eval.Point)  # -> XComponent, YComponent, ZComponent
bnd = Bounds(Numbers=flatten(pdecon.ZComponent))
dedomain = DeconstructDomain(Domain=bnd)  # -> Start, End
gradient = Gradient(
    LowerLimit=dedomain.Start,
    UpperLimit=dedomain.End,
    Parameter=flatten(pdecon.ZComponent),
    stops=[0: RGB(234, 38, 0), 0.25: RGB(234, 126, 0), 0.5: RGB(254, 244, 84), 0.75: RGB(173, 203, 249), 1: RGB(75, 107, 169)])
preview = CustomPreview(Geometry=flatten(contour), Material=gradient)
createatts = CreateAttributes(LayerName="Contours", Color=gradient, enableFullPath=False)
bake = BakeGeometry(Bake=Button(), Geometry=flatten(contour), Attributes=createatts, DeleteOldBakes=False, PreserveTrees=False)
