# Grasshopper definition Heron_Example.gh (Grasshopper 0.9.75)
# plug-ins: Heron, HDTReference, Weaverbird

# ---- group: U.S. Census Data Source
# DISCOVER REST DATA SOURCES
u_s_census_vectors = ValueList({"American Community Survey ACS 2013": "http://tigerweb.geo.census.gov/arcgis/rest/services/TIGERweb/tigerWMS_ACS2013/MapServer/", "Census 2010": "http://tigerweb.geo.census.gov/arcgis/rest/services/TIGERweb/tigerWMS_Census2010/MapServer/", "Census Current 2013": "http://tigerweb.geo.census.gov/arcgis/rest/services/TIGERweb/tigerWMS_Current/MapServer/", "Physical Features (ie roads)": "http://tigerweb.geo.census.gov/arcgis/rest/services/TIGERweb/tigerWMS_PhysicalFeatures/MapServer/"}, selected="Physical Features (ie roads)")

# ---- group: Catalog of ESRI ArcGIS REST Basemaps
esri_arcgis_base_maps = ValueList({"World Imagery": "http://server.arcgisonline.com/ArcGIS/rest/services/World_Imagery/MapServer/export?", "World Topographic": "http://server.arcgisonline.com/ArcGIS/rest/services/World_Topo_Map/MapServer/export?", "World Physical Map": "http://server.arcgisonline.com/ArcGIS/rest/services/World_Physical_Map/MapServer/export?", "World Street Map": "http://server.arcgisonline.com/ArcGIS/rest/services/World_Street_Map/MapServer/export?", "World DeLorme Street Map": "http://server.arcgisonline.com/ArcGIS/rest/services/Specialty/DeLorme_World_Base_Map/MapServer/export?", "World Shaded Relief": "http://server.arcgisonline.com/ArcGIS/rest/services/World_Shaded_Relief/MapServer/export?", "World Terrain Base": "http://server.arcgisonline.com/ArcGIS/rest/services/World_Terrain_Base/MapServer/export?", "World Boundaries and Places": "http://server.arcgisonline.com/ArcGIS/rest/services/Reference/World_Boundaries_and_Places/MapServer/export?", "World Boundaries and Places Alt": "http://server.arcgisonline.com/ArcGIS/rest/services/Reference/World_Boundaries_and_Places_Alternate/MapServer/export?", "World Reference Overlay": "http://server.arcgisonline.com/ArcGIS/rest/services/Reference/World_Reference_Overlay/MapServer/export?", "World Transportation": "http://server.arcgisonline.com/ArcGIS/rest/services/Reference/World_Transportation/MapServer/export?", "World Light Gray Base": "http://server.arcgisonline.com/ArcGIS/rest/services/Canvas/World_Light_Gray_Base/MapServer/export?", "World Light Gray Reference": "http://server.arcgisonline.com/ArcGIS/rest/services/Canvas/World_Light_Gray_Reference/MapServer/export?", "National Geographic World": "http://services.arcgisonline.com/ArcGIS/rest/services/NatGeo_World_Map/MapServer/export?", "USA Topo Maps": "http://server.arcgisonline.com/ArcGIS/rest/services/USA_Topo_Maps/MapServer/export?"}, selected="World Imagery")

# ---- group: ESRI Data Source
# GET REST VECTOR DATA
esri_demographics = ValueList({"USA 1990-2000 Population Change": "http://services.arcgisonline.com/arcgis/rest/services/Demographics/USA_1990-2000_Population_Change/MapServer/", "USA 2000-2010 Population Change": "http://services.arcgisonline.com/arcgis/rest/services/Demographics/USA_2000-2010_Population_Change/MapServer/", "USA Average Household Size": "http://services.arcgisonline.com/arcgis/rest/services/Demographics/USA_Average_Household_Size/MapServer/", "USA Diversity Index": "http://services.arcgisonline.com/arcgis/rest/services/Demographics/USA_Diversity_Index/MapServer/", "USA Labor Force Participation Rate": "http://services.arcgisonline.com/arcgis/rest/services/Demographics/USA_Labor_Force_Participation_Rate/MapServer", "USA Median Age": "http://services.arcgisonline.com/arcgis/rest/services/Demographics/USA_Median_Age/MapServer/", "USA Median Home Value": "http://services.arcgisonline.com/arcgis/rest/services/Demographics/USA_Median_Home_Value/MapServer/", "USA Median Household Income": "http://services.arcgisonline.com/arcgis/rest/services/Demographics/USA_Median_Household_Income/MapServer/", "USA Median Net Worth": "http://services.arcgisonline.com/arcgis/rest/services/Demographics/USA_Median_Net_Worth/MapServer/", "USA Owner Occupied Housing": "http://services.arcgisonline.com/arcgis/rest/services/Demographics/USA_Owner_Occupied_Housing/MapServer/", "USA Percent Over 64": "http://services.arcgisonline.com/arcgis/rest/services/Demographics/USA_Percent_Over_64/MapServer/", "USA Percent Under 18": "http://services.arcgisonline.com/arcgis/rest/services/Demographics/USA_Percent_Under_18/MapServer/", "USA Population by Sex": "http://services.arcgisonline.com/arcgis/rest/services/Demographics/USA_Population_by_Sex/MapServer/", "USA Population Density": "http://services.arcgisonline.com/arcgis/rest/services/Demographics/USA_Population_Density/MapServer", "USA Projected Population Change": "http://services.arcgisonline.com/arcgis/rest/services/Demographics/USA_Projected_Population_Change/MapServer/", "USA Recent Population Change": "http://services.arcgisonline.com/arcgis/rest/services/Demographics/USA_Recent_Population_Change/MapServer/", "USA Retail Spending Potential": "http://services.arcgisonline.com/arcgis/rest/services/Demographics/USA_Retail_Spending_Potential/MapServer/", "USA Social Vulnerability Index": "http://services.arcgisonline.com/arcgis/rest/services/Demographics/USA_Social_Vulnerability_Index/MapServer/", "USA Tapestry": "http://services.arcgisonline.com/arcgis/rest/services/Demographics/USA_Tapestry/MapServer/", "USA Unemployment Rate": "http://services.arcgisonline.com/arcgis/rest/services/Demographics/USA_Unemployment_Rate/MapServer/"}, selected="USA Median Household Income")

# ----
# Get Address Coordinates: Get a Decimal Degree coordinate with the Geocode service provided by ESRI.  This component uses HTTP GET to query and parses the JSON response.
# 
# NOTES:
# 
# + Requires the NewtonSoft.Json library
# GEOCODE
panel = Panel("Space Needle, Seattle")
restgeocode = ESRIRESTServiceGeocode(PointOfInterestOrAddress=panel)  # -> Candidates, Latitude, Longitude
panel_2 = Panel(restgeocode.Candidates)
branch = TreeBranch(Tree=restgeocode.Latitude, Path="0", MaintainPaths=True)
branch_2 = TreeBranch(Tree=restgeocode.Longitude, Path="0", MaintainPaths=True)
ddtoxy = DecimalDegreesToXY(Latitude=branch, Longitude=branch_2)

# ----
# Set the Earth Anchor Point: Runs a macro to set the Earth Anchor Point in Rhino.  This is important to minimize distortion translating from the curved surface of the Earth to Euclidean coordinates.
# SET EARTH ANCHOR POINT
# GET REST RASTER IMAGERY
toggle = BooleanToggle(True)
longitude = Number(branch)
latitude = Number(branch_2)
seteap = SetEarthAnchorPoint(SetEAP=toggle, Latitude=longitude, Longitude=latitude)

# ---- group: Input Boundary
# Description: This tool enables the import of GIS data from various sources into the Rhino/Grasshopper environment, located, scaled and cropped based on an Earth Anchor Point and a clipping polygon(s).  Sources of GIS data include Shapefiles, USGS IMG Elevation files and ArcGIS REST Services over the web.
# 
# NOTES:
# 
# + Please set your units to METERS.
# + Set the Earth Anchor Point before using any of the components.
# + Querying web services requires the Newtonsoft.Json  library and an internet connection
# + Parsing Shapefiles and IMG/HGT files requires GDAL/OGR libraries
# + These components use the EPSG:3857 and WGS84 Web Mercator projections.  See website below for an in-depth discussion of these projection:
# http://alastaira.wordpress.com/2011/01/23/the-google-maps-bing-maps-spherical-mercator-projection/
input_boundary_curve_s = Curve(<curve referenced from the Rhino model>)

# ---- group: USGS Raster Maps
usgs = ValueList({"Ortho 1 Foot Imagery": "http://raster.nationalmap.gov/arcgis/rest/services/Orthoimagery/USGS_EROS_Ortho_1Foot/ImageServer/exportImage?", "Ortho Imagery": "http://raster.nationalmap.gov/arcgis/rest/services/Orthoimagery/USGS_EROS_Ortho/ImageServer/exportImage?", "NAIP Imagery": "http://raster.nationalmap.gov/arcgis/rest/services/Orthoimagery/USGS_EROS_Ortho_NAIP/ImageServer/exportImage?", "Land Cover": "http://raster.nationalmap.gov/arcgis/rest/services/LandCover/USGS_EROS_LandCover_NLCD/MapServer/export?", "Land Cover - Conus 01": "http://raster.nationalmap.gov/arcgis/rest/services/LandCover/conus_01/MapServer/export?", "Land Cover - Conus 06": "http://raster.nationalmap.gov/arcgis/rest/services/LandCover/conus_06/MapServer/export?", "Land Cover - Development": "http://raster.nationalmap.gov/arcgis/rest/services/LandCover/Development_0106/MapServer/export?", "Land Cover - Wetland": "http://raster.nationalmap.gov/arcgis/rest/services/LandCover/Wetland_0106/MapServer/export?", "Topo - Scanned Maps": "http://raster.nationalmap.gov/arcgis/rest/services/Scanned_Maps/USGS_EROS_DRG_SCALE/ImageServer/exportImage?"}, selected="Ortho 1 Foot Imagery")

# ---- group: Not all imagery available at each resolution
resolution = ValueList({"None": , "Low": 256, "Med": 512, "High": 1024, "Max": 2048}, selected="Max")

# ----
crv = Curve(input_boundary_curve_s)

# ---- group: in_Input Boundaries
crv_2 = Curve(input_boundary_curve_s)

# ----
# IMPORT SHAPEFILES
# Import Shapefiles: This tool imports Shapefiles using GDAL/OGR Libraries. Output is in the form of points (for now) which can then be connected to form polylines.
# 
# NOTES:
# 
# + For Shapefiles with Multipolygons (ie building footprints with courtyards), the script reads mulitple branches of points per Feature.  To get the footprint, you will need to draw a polyline for each branch, shift the branches and use the Boundary Surface component.
# Download for Seattle Building Footprints: https://data.seattle.gov/dataset/BLDG2012/ndak-kqn5
# IMPORT TOPO
seattle_building_footprints = Panel("\BLDG2012_PLGN.shp")
importshp = ImportSHP(Boundary=crv_2)  # -> LayerName, ShpFeatureCount, ShpExtent, ShpSpatRef, Fields, Values, FeaturePoints

# ---- group: in_Input Boundaries
crv_3 = Curve(input_boundary_curve_s)

# ----
# Get Raster Imagery: Grabs JPGs of imagery from the specified web source (USGS or ESRI - Google Maps and Bing require API key).  Once downloaded to a folder the image is located and scaled to match the boundary in real world units (meters).
# 
# NOTES:
# 
# + The script overwrites previous images in the folder if an image of the same name exists.
# + Depending on the size and number of images you are requesting, this component may take awhile.
folder_location_for_images = Panel("C:\temp\")
update_imagery = BooleanToggle(True)
image_prefix = Panel("aerial")
restraster = GetRESTRaster(
    Boundary=crv_3,
    Resolution=resolution,
    FileLocation=folder_location_for_images,
    Prefix=image_prefix,
    RESTURL=usgs,
    Run=update_imagery)  # -> Image, ImageFrame, RESTQuery

# ---- group: in_Input Boundaries
crv_4 = Curve(input_boundary_curve_s)

# ----
# Import IMG files: This tool imports IMG and (STRM) HGT files using GDAL Libraries.  Output is in the form of a mesh.
# 
# NOTES:
# 
# + A source for IMG files in the United States is provided by USGS:
# 
# ftp://rockyftp.cr.usgs.gov/vdelivery/Datasets/Staged/NED/
# 
# There are three available resolutions 1, 1/3 and 1/9 arcsecond.  Typically you can round up to the next highest Lat/Lon to find the relevant file.
# 
# Lat: 47.620058522384
# Lon:-122.330459640299
# 
# becomes: n48w123.zip (or ned19_n47x75_w122x50_wa_puget_sound_2000.zip for 1/9 arcsecond)
# 
# + A source for STRM HGT files which cover most of the globe can be found from USGS in 1 arcsecond and 3 arcsecond resolutions at:
# 
# http://dds.cr.usgs.gov/srtm/version2_1/
# Download for Seattle 1/9 ArcSecond IMG: ftp://rockyftp.cr.usgs.gov/vdelivery/Datasets/Staged/NED/19/IMG/ned19_n47x75_w122x50_wa_puget_sound_2000.zip
seattle_1_9_arcsecond_img = Panel("\ned19_n47x75_w122x50_wa_puget_sound_2000.img")
path = FilePath()
importimg = ImportIMG(Boundary=crv_4, IMGLocation=path)  # -> TopoMesh, TopoExtent

field_names = Panel(importshp.Fields)
xy = XYPlane(Origin=Point(0, 0, 0))
boundary = BoundarySurfaces(Edges=restraster.ImageFrame)
image_boundary = Curve(boundary)
surfacemap = SurfaceMapping(Mesh=graft(crv_3), Surface=boundary)
image_filepath = FilePath(restraster.Image)
pline = PolyLine(Vertices=importshp.FeaturePoints, Closed=False)
surfacemap_2 = SurfaceMapping(Mesh=importimg.TopoMesh, Surface=image_boundary)
get_height = Panel("1")
contour = Contour(Shape=importimg.TopoMesh, Point=xy, Direction=Vector(0, 0, 1), Distance=Slider(1, range=0..10))
shapefile_extents = Curve(importshp.ShpExtent)
pshift = ShiftPaths(Data=pline, Offset=-1)
previewmat = CustomPreviewMaterials(Geometry=surfacemap, DiffuseColor=RGB(255, 255, 255), DiffuseBitmap=restraster.Image)
item = ListItem(List=importshp.Values, Index=get_height, Wrap=True)
previewmat_2 = CustomPreviewMaterials(Geometry=surfacemap_2, DiffuseColor=RGB(255, 255, 255), DiffuseBitmap=image_filepath)
neg = Negative(Value=item)
ft_to_meters = Panel("0.3048")
boundary_2 = BoundarySurfaces(Edges=pshift)
mesh = MeshBrep(
    Brep=boundary_2,
    Settings={GridMaxCount=0, GridMinCount=16, JaggedSeams=False, MaxEdgeLength=0, MinEdgeLength=0.0001, MinTolerance=0, Refine=True, RefineAngle=0, RelativeTolerance=0.65, SimplePlanes=True, Tolerance=0})
multiplication = Multiplication(A=neg, B=ft_to_meters)
wbthicken = WeaverbirdsMeshThicken(MeshCurves=mesh, Distance=multiplication, OffsetType=0)
clean = CleanTree(Tree=wbthicken, CleanInvalid=True, CleanEmpty=True)
unweld = UnweldMesh(Mesh=clean, Angle=0.7853981634)
swatch = ColourSwatch(SwatchColor=RGB(255, 255, 255))

# ----
# Get Vector Data: This tool queries the web source for geometry and associated data fields.
# 
# NOTES:
# 
# + Be mindful of the relative scale of data to be queried in relation to the boundary of interest.  Getting the geometry for every Census Block in the state may take some time through the REST service.  If this data is of interest, consider bringing it in with the Shapefile component.
update_vectors = BooleanToggle(True)

# ----
# Discover Data Sources: This tool can be used to discover data layers  from various data sources on the web. If the layers are a vector type, they return data similar to a shapefile, with geometry and associated data fields.  Feed the LayerURL output into the Get REST Vector or Get REST Raster component depending on the data type.
url_to_query = Text(esri_demographics)
restlayer = GetRESTServiceLayers(ServiceURL=url_to_query)  # -> MapDescription, MapLayer, MapInteger
map_description = Panel(restlayer.MapDescription)

# ---- group: Filter Layers - Useful for long Layer lists
search_list = Panel("block")
tmatch = MatchText(Text=restlayer.MapLayer, RegEx=search_list, Case=False)
cull = CullPattern(List=restlayer.MapLayer, CullPattern=tmatch)

# ---- group: Select Layer from Service
map_layers = ItemSelector(cull, {"Block Groups"}, selected="Block Groups")

# ----
tmatch_2 = MatchText(Text=restlayer.MapLayer, Pattern=map_layers, Case=True)
cull_2 = CullPattern(List=restlayer.MapInteger, CullPattern=tmatch_2)
layer_url = Evaluate(F="x&y&\"/\"", x=url_to_query, y=cull_2)

url_to_query_2 = Text(layer_url)
restvector = GetRESTVector(Boundary=crv, RESTURL=url_to_query_2, Run=update_vectors)  # -> FieldNames, FieldValues, FeaturePoints, RESTQuery
field_names_2 = Panel(restvector.FieldNames)
pline_2 = PolyLine(Vertices=restvector.FeaturePoints, Closed=False)
field_values = Panel(restvector.FieldValues)

list = ItemSelector(
    field_names_2,
    {"OBJECTID", "ID", "Name", "State Abbreviation", "Land Area in Square Miles", "2012 Total Population (Esri)", "2012 Median Household Income (Esri)", "2012 Households by Income Base (Esri)", "2012 Household Income $0-$24,999 (Esri)", "2012 Household Income $25,000-$49,999 (Esri)", "2012 Household Income $50,000-$74,999  (Esri)": "2012 Household Income $50,000-$74,999 (Esri)", "2012 Household Income $75,000-$99,999  (Esri)": "2012 Household Income $75,000-$99,999 (Esri)", "2012 Household Income $100,000-$149,999  (Esri)": "2012 Household Income $100,000-$149,999 (Esri)", "2012 Household Income $150,000-$199,999  (Esri)": "2012 Household Income $150,000-$199,999 (Esri)", "2012 Household Income $200,000 or greater (Esri)", "Household Income Above or Below U.S. Avg"}, selected="2012 Median Household Income (Esri)")
tmatch_3 = MatchText(Text=restvector.FieldNames, Pattern=list, Case=True)
cull_3 = CullPattern(List=restvector.FieldValues, CullPattern=tmatch_3)
bnd = Bounds(Numbers=flatten(cull_3))
dedomain = DeconstructDomain(Domain=bnd)  # -> Start, End
gradient = Gradient(LowerLimit=dedomain.Start, UpperLimit=dedomain.End, Parameter=cull_3, stops=[0: RGB(204, 242, 255), 1: RGB(0, 113, 189)])

# ---- group: Color based on Demographics
demographic_boundaries = Curve(pline_2)
area = Area(Geometry=wbthicken)  # -> Area, Centroid
demographic_colors = Data(gradient)
incurves = PointInCurves(Point=area.Centroid, Curves=flatten(demographic_boundaries))  # -> Relationship, Index, Point
item_2 = ListItem(List=flatten(demographic_colors), Index=incurves.Index, Wrap=True)
clean_2 = CleanTree(Tree=item_2, CleanInvalid=True, CleanEmpty=True)

# ----
c_meshfrompolyline = CSharpScript(x=pline_2)  # -> out, A; inputs x: Polyline
# ---------- c_meshfrompolyline: C# ----------
    A = Mesh.CreateFromClosedPolyline(x);
# ---------- end c_meshfrompolyline ----------
previewmat_3 = CustomPreviewMaterials(Geometry=unweld, DiffuseColor=clean_2, Transparency=0)
previewmat_4 = CustomPreviewMaterials(Geometry=c_meshfrompolyline.A, DiffuseColor=gradient, Transparency=0.25)
