# Grasshopper definition 3 OSC Iphone to Grasshopper.ghx (Grasshopper 1.0.8)
# plug-ins: gHowl

# ----
# OSC with GHOWL
netsource = NetworkSource()  # -> NetworkAdapterIsUp, AdapterProperties, LocalIpAddress
# OSC is a protocoll that sits on top of UDP. It's a simplified version. Here we use the components of gHowl. But both are doing the same.
panel = Panel("""/data/location/latitude
/data/location/longitude
/data/location/altitude""")
local_ip_adress_of_your_computer = Panel(netsource.LocalIpAddress)
send_pattern_osc = Panel("999")
port = Panel("8000")
udp = UDPReceiver(Address=netsource.LocalIpAddress, Port=port, Pattern=send_pattern_osc)  # -> Info, Data
message = Panel([udp.Info, udp.Data])
osc_d = OSCDispatch(OSCDevices=panel, OSCMessage=udp.Data)  # -> OSCDevice, OSCData
osc_data = Panel(osc_d.OSCData)

item = ListItem(List=osc_d.OSCData, Index=0, Wrap=True)  # -> Item, Item1
concat = Concatenate(FragmentA="https://www.google.com/maps/@", FragmentB=item.Item, FragmentC=",", FragmentD=item.Item1, FragmentE=",18z")
copy_paste_this_into_your_browser = Panel(concat)
