# Grasshopper definition SuperSerial.gh (Grasshopper 1.0.8)
# plug-ins: superSerial

superserial = SuperSerial(Switch=Toggle(True), Baud="9600", Port="COM3", Mode=2, Trigger=False)  # -> Status, Sent, Received
panel = Panel(superserial.Received)
dam = DataDam(DataA=panel, BufferDelay=2500000, BufferMode=2)
rec = DataRecorder(dam, DataLimit=100, RecordData=True)
panel_2 = Panel(rec)
lng = ListLength(List=panel_2)
series = Series(Start=0, Step=1, Count=lng)
multiplication = Multiplication(A=panel_2, B=Slider(-8.7, range=-10..10))
pt = ConstructPoint(XCoordinate=0, YCoordinate=series, ZCoordinate=0)
pt_2 = ConstructPoint(XCoordinate=0, YCoordinate=series, ZCoordinate=multiplication)
pt_3 = ConstructPoint(XCoordinate="-10", YCoordinate=series, ZCoordinate=0)
pt_4 = ConstructPoint(XCoordinate="10", YCoordinate=series, ZCoordinate=0)
nurbs = NurbsCurve(Vertices=pt_3, Degree=3, Periodic=False)  # -> Curve, Length, Domain
nurbs_2 = NurbsCurve(Vertices=pt_2, Degree=3, Periodic=False)  # -> Curve, Length, Domain
nurbs_3 = NurbsCurve(Vertices=pt_4, Degree=3, Periodic=False)  # -> Curve, Length, Domain
loft = Loft(
    Curves=[nurbs.Curve, nurbs_2.Curve, nurbs_3.Curve],
    Options={Adjust=False, Closed=False, LoftEnds=0, LoftSimp=0, LoftType=0, Rebuild=10, Refit=0.01})
preview = CustomPreview(Geometry=loft, Material=ColourSwatch(SwatchColor=RGB(255, 255, 255)))
