# Grasshopper definition 2 Arduino to Grasshopper UDP.gh (Grasshopper 1.0.8)
# plug-ins: gHowl

netsource = NetworkSource()  # -> NetworkAdapterIsUp, AdapterProperties, LocalIpAddress
# This is the IP of your computer
#  in your network.
# This number goes into the arduino
# script.
panel = Panel(netsource.LocalIpAddress)
udp = UDPReceiver(Address=panel, Port="8050", Pattern="0")  # -> Info, Data
panel_2 = Panel(udp.Data)
rec = DataRecorder(udp.Data, DataLimit=-10, RecordData=False)
panel_3 = Panel(rec)
